# Grasshopper definition Temperature数据准备.gh (Grasshopper 1.0.7)
# plug-ins: TT Toolbox

panel = Panel("https://www.energyplus.net/weather-download/asia_wmo_region_2/CHN//CHN_Shanghai.Shanghai.583620_SWERA/all")
downloadepw = LBDownloadWeather(weather_URL=panel)  # -> epw_file, stat_file, ddy_file; plug-in component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
epwmap = LBEPWmap(epw_map=Slider(1, range=0..1))  # -> Output; plug-in component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
importepw = LBImportEPW(epw_file=downloadepw.epw_file)  # -> location, dry_bulb_temperature, dew_point_temperature, relative_humidity, wind_speed, wind_direction, direct_normal_rad, diffuse_horizontal_rad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; plug-in component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
xdata = LBDeconstructData(data=importepw.dew_point_temperature)  # -> header, values; plug-in component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
partition_list = PartitionList(List=xdata.values, Size=Slider(24, range=0..100))
panel_2 = Panel("""1/1/2021
1/2/2021
1/3/2021
1/4/2021
1/5/2021
1/6/2021
1/7/2021
1/8/2021
1/9/2021
1/10/2021
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""")
average = Average(Input=partition_list)
text_split = TextSplit(Text=panel_2, Separators="/")
series = Series(Start=Slider(1, range=0..1), Step=1, Count=Slider(365, range=0..1000))  # -> graft(Series)
mean = Number(average)
panel_3 = Panel("""Month
Day
Year
Day of year
Temperature""")
insert_items = InsertItems(List=text_split, Item=[series, mean], Indices=Slider(3, range=0..10), Wrap=True)
write_to_excel = WriteToExcel(
    Run=Slider(1, range=0..1),
    ExcelWorksheet="1",
    ColumnNames=panel_3,
    WriteOptions="None",
    ColumnnsOrRows=True,
    DataToWriteIntoColumns=insert_items)
